# Dynamo graph RebarIsolFootings.dyn (Dynamo 2.10.1.3976)

# group: Isolated footings' concrete
dimensions_and_concrete_cover_of = Filename("..\Dynamo_visualization\dim_footings_collection.csv")  # "Dimensions and concrete cover of footings"; graph input
importCSV = Data.ImportCSV(filePath=dimensions_and_concrete_cover_of)
transpose = List.Transpose(lists=importCSV)
global_base_coordinates_of_each = Filename("..\Dynamo_visualization\coord_base_footings.csv")  # "Global base coordinates of each footing"; graph input
importCSV_2 = Data.ImportCSV(filePath=global_base_coordinates_of_each)
transpose_2 = List.Transpose(lists=importCSV_2)
isolated_footings_concrete = Python(IN[0]=transpose, IN[1]=transpose_2)  # IronPython2
# ---------- isolated_footings_concrete.python (32 lines) ----------
import clr
clr.AddReference('ProtoGeometry')
from Autodesk.DesignScript.Geometry import *
dataEnteringNode = IN

list_foot=[]

basic_foot=IN[0]
coordenadas_foot=IN[1]

nfootings=len(coordenadas_foot)
for i in range(0,nfootings):
	span=basic_foot[i][0]*0.01
	b=basic_foot[i][1]*0.01
	h=basic_foot[i][2]*0.01
	
	xf=coordenadas_foot[i][0]*0.01
	yf=coordenadas_foot[i][1]*0.01
	zf=coordenadas_foot[i][2]*0.01
	
	pf1=Point.ByCoordinates(xf-0.5*b,yf-0.5*span,zf+0.5*h)
	pf2=Point.ByCoordinates(xf+0.5*b,yf-0.5*span,zf+0.5*h)
	pf3=Point.ByCoordinates(xf+0.5*b,yf-0.5*span,zf-0.5*h)
	pf4=Point.ByCoordinates(xf-0.5*b,yf-0.5*span,zf-0.5*h)

	myFootRec=Rectangle.ByCornerPoints(pf1,pf2,pf3,pf4)
	pfoot=Curve.Extrude(myFootRec,Vector.ByCoordinates(0,1,0),span)
			
	list_foot.append(pfoot)
			
		
OUT=list_foot
# ----------------------------------------
color_palette = ColorPalette({R: 255, G: 0, B: 0, A: 255})
transparency_of_footings = DoubleSlider(3.2, range=1..10 step 0.1)  # "Transparency of footings' concrete"
divide = Color.Divide(c1=color_palette, div=transparency_of_footings)
byGeometryColor = Modifiers.GeometryColor.ByGeometryColor(geometry=isolated_footings_concrete, color=divide)

# group: Rebar of Isolated Footings
number_of_rebars_for_each = Filename("..\Dynamo_visualization\nrebar_footings_collection.csv")  # "Number of rebars for each footing"; graph input
importCSV_3 = Data.ImportCSV(filePath=number_of_rebars_for_each)
transpose_3 = List.Transpose(lists=importCSV_3)
rebar_distribution_local = Filename("..\Dynamo_visualization\collection_disposition_rebar_footings.csv")  # "Rebar distribution (local coordinates) of each footing"; graph input
importCSV_4 = Data.ImportCSV(filePath=rebar_distribution_local)
transpose_4 = List.Transpose(lists=importCSV_4)
rebar_diameter_s_index = Filename("..\..\..\..\..\..\..\DynamoRevit\Dynamo_visualization\collection_type_bar_footings.csv")  # graph input
importCSV_5 = Data.ImportCSV(filePath=rebar_diameter_s_index)
transpose_5 = List.Transpose(lists=importCSV_5)
rebar_isolated_footings = Python(IN[0]=transpose, IN[1]=transpose_2, IN[2]=transpose_3, IN[3]=transpose_4, IN[4]=transpose_5)  # IronPython2
# ---------- rebar_isolated_footings.python (75 lines) ----------
import clr
clr.AddReference('ProtoGeometry')
from Autodesk.DesignScript.Geometry import *
dataEnteringNode = IN

list_bars=[]

basic_foot=IN[0]
coordenadas_foot=IN[1]
nbars_foot=IN[2]
coord_varillas=IN[3]
tipovar=IN[4]


availableRebar=[[4,1.27,1.266768698],
				[5,1.5875,1.97932609],
				[6,1.905,2.85022957],
				[8,2.54,5.067074791],
				[9,2.8575,6.413016532],
				[10,3.175,7.917304361],
				[12,3.81,11.40091828]]

nfootings=len(coordenadas_foot)
sumanv_foot=0
nvar=0
points_collec=[]
span_collec=[]
for i in range(0,nfootings):
	span=basic_foot[i][0]*0.01
	for j in range(0,2): # rebar over the L section
		
		nvar=nvar+nbars_foot[i][j]
		for k in range(int(sumanv_foot),int(nvar)):
			index_bar=tipovar[k][0]
			diam_bar=availableRebar[index_bar-1][1]
			rvar=diam_bar*0.01*0.5
			
			xvar=coord_varillas[k][0]*0.01+coordenadas_foot[i][0]*0.01
			zvar=coord_varillas[k][1]*0.01+coordenadas_foot[i][2]*0.01
	
			center_point=Point.ByCoordinates(xvar,coordenadas_foot[i][1]*0.01-0.5*span,zvar)
			
			points_collec.append(center_point)
			myColCirc=Circle.ByCenterPointRadiusNormal(center_point,rvar,Vector.ByCoordinates(0,1,0))
			
			pfoot=Curve.Extrude(myColCirc,Vector.ByCoordinates(0,1,0),span)
			
			list_bars.append(pfoot)
			
		sumanv_foot=sumanv_foot+nbars_foot[i][j]
		
	span=basic_foot[i][1]*0.01
	for j in range(2,4): # rebar over the B section
		
		nvar=nvar+nbars_foot[i][j]
		for k in range(int(sumanv_foot),int(nvar)):
			index_bar=tipovar[k][0]
			diam_bar=availableRebar[index_bar-1][1]
			rvar=diam_bar*0.01*0.5
			
			yvar=coord_varillas[k][0]*0.01+coordenadas_foot[i][1]*0.01
			zvar=coord_varillas[k][1]*0.01+coordenadas_foot[i][2]*0.01
	
			center_point=Point.ByCoordinates(coordenadas_foot[i][0]*0.01-0.5*span,yvar,zvar)
			
			points_collec.append(center_point)
			myColCirc=Circle.ByCenterPointRadiusNormal(center_point,rvar,Vector.ByCoordinates(1,0,0))
			
			pfoot=Curve.Extrude(myColCirc,Vector.ByCoordinates(1,0,0),span)
			
			list_bars.append(pfoot)
			
		sumanv_foot=sumanv_foot+nbars_foot[i][j]
	
OUT=list_bars
# ----------------------------------------
color_palette_2 = ColorPalette({R: 255, G: 0, B: 0, A: 255})
byGeometryColor_2 = Modifiers.GeometryColor.ByGeometryColor(geometry=rebar_isolated_footings, color=color_palette_2)
