# Dynamo graph RebarRectangBeams.dyn (Dynamo 2.10.1.3976)

# group: Beams' concrete, longitudinal rebar and transversal rebar
radius_corner_fold = DoubleInput(0.02)
stirrup_radius_m = Formula("3/8*2.54*0.01*0.5;")
shear_reinforcement = Filename("..\Dynamo_visualization\shear_beam_design.csv")  # graph input
importCSV = Data.ImportCSV(filePath=shear_reinforcement)
transpose = List.Transpose(lists=importCSV)
geometry_of_beams = Filename("..\Dynamo_visualization\dim_beams_collection.csv")  # graph input
importCSV_2 = Data.ImportCSV(filePath=geometry_of_beams)
transpose_2 = List.Transpose(lists=importCSV_2)
location_of_beams = Filename("..\..\..\..\..\..\..\DynamoRevit\Dynamo_visualization\coord_begin_beams.csv")  # graph input
importCSV_3 = Data.ImportCSV(filePath=location_of_beams)
transpose_3 = List.Transpose(lists=importCSV_3)
rectangular_stirrups_in_beams = Python(IN[0]=radius_corner_fold, IN[1]=stirrup_radius_m, IN[2]=transpose, IN[3]=transpose_2, IN[4]=transpose_3)  # IronPython2
# ---------- rectangular_stirrups_in_beams.python (190 lines) ----------
# MAIN PROGRAM -----------------------------------------------------------
# Load libraries
import sys
import clr

clr.AddReference('ProtoGeometry')
from Autodesk.DesignScript.Geometry import *

# The inputs to this node will be stored as a list in the IN variables.
dataEnteringNode = IN

# Assign your output to the OUT variable.

rd=IN[0]
rv=IN[1]
shear_design = IN[2]
basic = IN[3]
ejes = IN[4]

nbeams=len(shear_design)

lista_x = []
lista_y = []
lista_z = []
for i in range(0,nbeams):
	
	s1=shear_design[i][0]
	s2=shear_design[i][1]
	s3=shear_design[i][2]
	
	d1=shear_design[i][3]
	d2=shear_design[i][4]
	
	span=basic[i][2]
	
	# The y coordinate location of each stirrup is to be computed
	# along each beam's length

	y0=5 # This is the lowest local level of a stirrup in a column 
	ye=[]
	j=0
	while y0<float(d1):
		y00=y0+ejes[i][1]
		ye.append(y00)
		y0=y0+s1
		j=j+1
	
	if (d1+d2)!=span:
		k=0
		while y0<float(span-d2):
			y00=y0+ejes[i][1]
			ye.append(y00)
			y0=y0+s2
			k=k+1
	
	n=0
	while y0<float(span):
		y00=y0+ejes[i][1]
		ye.append(y00)
		y0=y0+s3
		n=n+1
		
	lista_y.append(ye)
	
	x1 = ejes[i][0]*0.01
	lista_x.append(x1)
	z1 = ejes[i][2]*0.01
	lista_z.append(z1)
		
    
centro_0=lista_z
centro_1=lista_x
centro_2=lista_y

basicos=basic

## Hook length
db=2*rv
lga=max(6*db,0.08)

lista_dobleces=[]
lista_ld=[]

nelem=len(centro_0)
for j in range(0,nelem):
	ne=len(centro_2[j])
	b=basicos[j][0]*0.01
	h=basicos[j][1]*0.01
	rec=basicos[j][3]*0.01;
	bp=b-2*rec
	hp=h-2*rec
	xa=centro_1[j]
	za=centro_0[j]
	x=xa+bp*0.5
	z=za-0.5*hp-rd
	for i in range(0,ne):
		y=centro_2[j][i]*0.01
		# lower-right corner -------------------------------------------
		esq=Point.ByCoordinates(x,y,z)
		n=Vector.ByCoordinates(1,0,0)
		e=Circle.ByCenterPointRadiusNormal(esq,rv,n)
		axisOrigin=Point.ByCoordinates(x,y,z+rd)
		axisDir=Vector.ByCoordinates(0,-1,0)
		doblez=Solid.ByRevolve(e,axisOrigin,axisDir,0,90)
		lista_dobleces.append(doblez)
		
		# right side ---------------------------------------------------
		cld=Circle.ByCenterPointRadiusNormal(Point.ByCoordinates(x+rd,y,z+rd),rv,Vector.ByCoordinates(0,0,1))
		ld=Curve.Extrude(cld,Vector.ByCoordinates(0,0,1),hp)
		lista_ld.append(ld)
		
		# top right corner ---------------------------------------------
		esq=Point.ByCoordinates(x+rd,y,hp+rd+z)
		n=Vector.ByCoordinates(0,0,1)
		e=Circle.ByCenterPointRadiusNormal(esq,rv,n)
		axisOrigin=Point.ByCoordinates(x,y,z+hp+rd)
		axisDir=Vector.ByCoordinates(0,-1,0)
		doblez=Solid.ByRevolve(e,axisOrigin,axisDir,0,90)
		lista_dobleces.append(doblez)

		# top side -----------------------------------------------------
		cld=Circle.ByCenterPointRadiusNormal(Point.ByCoordinates(x,y,hp+2*rd+z),rv,Vector.ByCoordinates(1,0,0))
		ld=Curve.Extrude(cld,Vector.ByCoordinates(-1,0,0),bp)
		lista_ld.append(ld)
		
		# top left corner ----------------------------------------------
		esq=Point.ByCoordinates(-bp+x,y,hp+2*rd+z)
		n=Vector.ByCoordinates(1,0,0)
		e=Circle.ByCenterPointRadiusNormal(esq,rv,n)
		axisOrigin=Point.ByCoordinates(-bp+x,y,hp+z+rd)
		axisDir=Vector.ByCoordinates(0,-1,0)
		doblez=Solid.ByRevolve(e,axisOrigin,axisDir,0,90)
		lista_dobleces.append(doblez)
		
		# left side ----------------------------------------------------
		cld=Circle.ByCenterPointRadiusNormal(Point.ByCoordinates(x-bp-rd,y,hp+z+rd),rv,Vector.ByCoordinates(0,0,1))
		ld=Curve.Extrude(cld,Vector.ByCoordinates(0,2*rv/(hp),-1),hp)
		lista_ld.append(ld)
		
		# lower left corner ---------------------------------------------
		esq=Point.ByCoordinates(-bp+x-rd,y+2*rv,z+rd)
		n=Vector.ByCoordinates(0,0,1)
		e=Circle.ByCenterPointRadiusNormal(esq,rv,n)
		axisOrigin=Point.ByCoordinates(-bp+x,y+2*rv,z+rd)
		axisDir=Vector.ByCoordinates(0,-1,0)
		doblez=Solid.ByRevolve(e,axisOrigin,axisDir,0,90)
		lista_dobleces.append(doblez)
		
		# lower side ----------------------------------------------------
		
		cld=Circle.ByCenterPointRadiusNormal(Point.ByCoordinates(x-bp,y+2*rv,z),rv,Vector.ByCoordinates(1,0,0))
		ld=Curve.Extrude(cld,Vector.ByCoordinates(1,0,0),bp)
		lista_ld.append(ld)
		
		# outer lower right corner
		esq=Point.ByCoordinates(x,y+2*rv,z)
		n=Vector.ByCoordinates(1,0,0)
		e=Circle.ByCenterPointRadiusNormal(esq,rv,n)
		axisOrigin=Point.ByCoordinates(x,y+2*rv,z+rd)
		axisDir=Vector.ByCoordinates(0,-1,0)
		doblez=Solid.ByRevolve(e,axisOrigin,axisDir,0,90)
		lista_dobleces.append(doblez)
		
		# right hook ----------------------------------------------------
		esq=Point.ByCoordinates(x+rd,2*rv+y,z+rd)
		n=Vector.ByCoordinates(0,0,1)
		e=Circle.ByCenterPointRadiusNormal(esq,rv,n)
		axisOrigin=Point.ByCoordinates(x,y+2*rv,z+rd)
		axisDir=Vector.ByCoordinates(0,-1,0)
		doblez=Solid.ByRevolve(e,axisOrigin,axisDir,0,45)
		lista_dobleces.append(doblez)
		
		lg=Circle.ByCenterPointRadiusNormal(Point.ByCoordinates(0.7071*rd+x,y+2*rv,z+1.7071*rd),rv,Vector.ByCoordinates(-1,0,1))
		ld=Curve.Extrude(lg,Vector.ByCoordinates(-1,0,1),lga)
		lista_ld.append(ld)
		
		# left hook ----------------------------------------------------
		esq=Point.ByCoordinates(x,y,z)
		n=Vector.ByCoordinates(-1,0,0)
		e=Circle.ByCenterPointRadiusNormal(esq,rv,n)
		axisOrigin=Point.ByCoordinates(x,y,z+rd)
		axisDir=Vector.ByCoordinates(0,-1,0)
		doblez=Solid.ByRevolve(e,axisOrigin,axisDir,0,-45)
		lista_dobleces.append(doblez)
		
		lg=Circle.ByCenterPointRadiusNormal(Point.ByCoordinates(-0.7071*rd+x,y,z+(1-0.7071)*rd),rv,Vector.ByCoordinates(-1,0,1))
		ld=Curve.Extrude(lg,Vector.ByCoordinates(-1,0,1),lga)
		lista_ld.append(ld)
		
OUT = [lista_ld,lista_dobleces]
# ----------------------------------------
color_palette = ColorPalette({R: 127, G: 255, B: 0, A: 255})
byGeometryColor = Modifiers.GeometryColor.ByGeometryColor(geometry=rectangular_stirrups_in_beams, color=color_palette)
rebar_diameters_data = Filename("..\..\..\..\..\..\..\DynamoRevit\Dynamo_visualization\collection_type_bar_beams.csv")  # graph input
importCSV_4 = Data.ImportCSV(filePath=rebar_diameters_data)
transpose_4 = List.Transpose(lists=importCSV_4)
number_of_rebars_of_each_beam = Filename("..\Dynamo_visualization\nrebar_beams_collection.csv")  # graph input
importCSV_5 = Data.ImportCSV(filePath=number_of_rebars_of_each_beam)
transpose_5 = List.Transpose(lists=importCSV_5)
distribution_of_rebars_of_each = Filename("..\Dynamo_visualization\collection_disposition_rebar_beams3sec.csv")  # "Distribution of rebars of each beam"; graph input
importCSV_6 = Data.ImportCSV(filePath=distribution_of_rebars_of_each)
transpose_6 = List.Transpose(lists=importCSV_6)
longitudinal_rebar_beams = Python(IN[0]=transpose_2, IN[1]=transpose_3, IN[2]=transpose_4, IN[3]=transpose_5, IN[4]=transpose_6)  # IronPython2
# ---------- longitudinal_rebar_beams.python (60 lines) ----------
import clr
clr.AddReference('ProtoGeometry')
from Autodesk.DesignScript.Geometry import *
dataEnteringNode = IN

list_bars=[]

basic_beams=IN[0]
coordenadas_beam=IN[1]
tipovar=IN[2]
nbars_beam=IN[3]
coord_varillas=IN[4]

availableRebar=[[4,1.27,1.266768698],
				[5,1.5875,1.97932609],
				[6,1.905,2.85022957],
				[8,2.54,5.067074791],
				[9,2.8575,6.413016532],
				[10,3.175,7.917304361],
				[12,3.81,11.40091828]]

nbeams=len(coordenadas_beam)
sumanv_beam=0
nvar=0
points_collec=[]
for i in range(0,nbeams):
		
	span=basic_beams[i][2]*0.01
	for j in range(0,6):
		if j==0 or j==1:
			sec=0
		elif j==2 or j==3:
			sec=1
		elif j==4 or j==5:
			sec=2
			
		nvar=nvar+nbars_beam[i][j]
		for k in range(int(sumanv_beam),int(nvar)):
			index_bar=tipovar[k][0]
			diam_bar=availableRebar[index_bar-1][1]
			rvar=diam_bar*0.01*0.5
			
			xvar=coord_varillas[k][0]*0.01+coordenadas_beam[i][0]*0.01
			zvar=coord_varillas[k][1]*0.01+coordenadas_beam[i][2]*0.01
	
			center_point=Point.ByCoordinates(xvar,coordenadas_beam[i][1]*0.01+sec*0.333*span,zvar)
			
			points_collec.append(center_point)
			myColCirc=Circle.ByCenterPointRadiusNormal(center_point,rvar,Vector.ByCoordinates(0,1,0))
			
			pbeam=Curve.Extrude(myColCirc,Vector.ByCoordinates(0,1,0),span*0.333)
			
			list_bars.append(pbeam)
		
		sumanv_beam=sumanv_beam+nbars_beam[i][j]
		
	
#OUT=list_bars
#OUT=points_collec
OUT=list_bars
# ----------------------------------------
color_palette_2 = ColorPalette({R: 0, G: 255, B: 255, A: 255})
byGeometryColor_2 = Modifiers.GeometryColor.ByGeometryColor(geometry=longitudinal_rebar_beams, color=color_palette_2)
concrete_beam_solid = Python(IN[0]=transpose_2, IN[1]=transpose_3)  # IronPython2
# ---------- concrete_beam_solid.python (33 lines) ----------
import clr
clr.AddReference('ProtoGeometry')
from Autodesk.DesignScript.Geometry import *
dataEnteringNode = IN

list_beams=[]

basic_beams=IN[0]
coordenadas_beam=IN[1]

nbeams=len(coordenadas_beam)
for i in range(0,nbeams):
		
	span=basic_beams[i][2]*0.01
	b=float(basic_beams[i][0])*0.01
	h=float(basic_beams[i][1])*0.01
	
	xb=coordenadas_beam[i][0]*0.01
	yb=coordenadas_beam[i][1]*0.01
	zb=coordenadas_beam[i][2]*0.01
	
	pr1=Point.ByCoordinates(xb-0.5*b,yb,zb+0.5*h)	
	pr2=Point.ByCoordinates(xb+0.5*b,yb,zb+0.5*h)
	pr3=Point.ByCoordinates(xb+0.5*b,yb,zb-0.5*h)
	pr4=Point.ByCoordinates(xb-0.5*b,yb,zb-0.5*h)
	
	mybeamRec=Rectangle.ByCornerPoints(pr1,pr2,pr3,pr4)	
	pbeam=Curve.Extrude(mybeamRec,Vector.ByCoordinates(0,1,0),span)
	
			
	list_beams.append(pbeam)
		
OUT=list_beams
# ----------------------------------------
color_palette_3 = ColorPalette({R: 0, G: 255, B: 255, A: 255})
transparency_of_beam_concrete = DoubleSlider(3, range=1..10 step 0.1)
divide = Color.Divide(c1=color_palette_3, div=transparency_of_beam_concrete)
byGeometryColor_3 = Modifiers.GeometryColor.ByGeometryColor(geometry=concrete_beam_solid, color=divide)
