# Dynamo graph RebarRectangColumns.dyn (Dynamo 2.10.1.3976)

# group: Columns' concrete solids, longitudinal rebar and transversal reinforcement
location_of_columns = Filename("..\..\..\..\..\..\..\DynamoRevit\Dynamo_visualization\coord_base_columns.csv")
importCSV = Data.ImportCSV(filePath=location_of_columns)
column_location = List.Transpose(lists=importCSV)
geometry_of_columns = Filename("..\..\..\..\..\..\..\DynamoRevit\Dynamo_visualization\dim_cols_collection.csv")  # graph input
importCSV_2 = Data.ImportCSV(filePath=geometry_of_columns)
column_dimensions = List.Transpose(lists=importCSV_2)
number_of_rebars_of_each_column = Filename("..\..\..\..\..\..\..\DynamoRevit\Dynamo_visualization\nrebar_cols_collection.csv")  # graph input
importCSV_3 = Data.ImportCSV(filePath=number_of_rebars_of_each_column)
number_of_rebars_of_each_column_2 = List.Transpose(lists=importCSV_3)
rebar_diameter_data_of_each = Filename("..\..\..\..\..\..\..\DynamoRevit\Dynamo_visualization\collection_type_bar_cols.csv")  # "Rebar diameter data of each column's rebar"; graph input
importCSV_4 = Data.ImportCSV(filePath=rebar_diameter_data_of_each)
transpose = List.Transpose(lists=importCSV_4)
distribution_of_rebars_in_each = Filename("..\..\..\..\..\..\..\DynamoRevit\Dynamo_visualization\collection_disposition_rebar_cols.csv")  # "Distribution of rebars in each column"; graph input
importCSV_5 = Data.ImportCSV(filePath=distribution_of_rebars_in_each)
transpose_2 = List.Transpose(lists=importCSV_5)
longitudinal_rebar_columns = Python(IN[0]=column_location, IN[1]=column_dimensions, IN[2]=number_of_rebars_of_each_column_2, IN[3]=transpose, IN[4]=transpose_2)  # IronPython2
# ---------- longitudinal_rebar_columns.python (45 lines) ----------
import clr
clr.AddReference('ProtoGeometry')
from Autodesk.DesignScript.Geometry import *
dataEnteringNode = IN

# INPUT
coord_col=IN[0]
basic=IN[1]
nbars_col=IN[2]
tipovar=IN[3]
coordbars=IN[4]

availableRebar=[[4,1.27,1.266768698],
				[5,1.5875,1.97932609],
				[6,1.905,2.85022957],
				[8,2.54,5.067074791],
				[9,2.8575,6.413016532],
				[10,3.175,7.917304361],
				[12,3.81,11.40091828]]
# MAIN LOOP
list_bars=[]
ncols=len(coord_col)
sumanv_col=0
nvar=0
for i in range(0,ncols):
	nvar=nvar+nbars_col[i][0]
	hc=float(basic[i][2])*0.01
	for b in range(0+int(sumanv_col),int(nvar)):
		xvar=coordbars[b][0]*0.01+float(coord_col[i][0])*0.01
		yvar=coordbars[b][1]*0.01+float(coord_col[i][1])*0.01
		
		tv=tipovar[b][0]-1
		typeRebar=availableRebar[tv][0]
		rvar=float(typeRebar)/8*2.54*0.01*0.5
		
		center_point=Point.ByCoordinates(xvar,yvar,float(coord_col[i][2])*0.01+0.5*hc)
		myColCirc=Circle.ByCenterPointRadius(center_point,rvar)
		psur=Surface.ByPatch(myColCirc)
		ptorre=Surface.Thicken(psur,hc)
		list_bars.append(ptorre)
		
	sumanv_col=sumanv_col+nbars_col[i][0]
		
	
OUT=list_bars
# ----------------------------------------
color_palette = ColorPalette({R: 34, G: 139, B: 34, A: 255})
byGeometryColor = Modifiers.GeometryColor.ByGeometryColor(geometry=longitudinal_rebar_columns, color=color_palette)
concrete_column_solid = Python(IN[0]=column_location, IN[1]=column_dimensions)  # IronPython2
# ---------- concrete_column_solid.python (26 lines) ----------
import clr
clr.AddReference('ProtoGeometry')
from Autodesk.DesignScript.Geometry import *
dataEnteringNode = IN

# INPUT

coord_col=IN[0]
basic=IN[1]

# MAIN LOOP
list_cols=[]
ncols=len(coord_col)
for i in range(0,ncols):
	hc=float(basic[i][2])*0.01
	b=basic[i][0]*0.01
	h=basic[i][1]*0.01
	
	csAxis=CoordinateSystem.ByOrigin(coord_col[i][0]*0.01,coord_col[i][1]*0.01,coord_col[i][2]*0.01+0.5*hc)
	myColRec=Rectangle.ByWidthLength(csAxis,b,h)
	psur=Surface.ByPatch(myColRec)
	ptorre=Surface.Thicken(psur,hc)
	list_cols.append(ptorre)
		
	
OUT=list_cols
# ----------------------------------------
color_palette_2 = ColorPalette({R: 255, G: 182, B: 193, A: 255})
transparency_of_columns_solids = DoubleSlider(2.8, range=1..10 step 0.1)
divide = Color.Divide(c1=color_palette_2, div=transparency_of_columns_solids)
byGeometryColor_2 = Modifiers.GeometryColor.ByGeometryColor(geometry=concrete_column_solid, color=divide)
stirrup_radius_m = Formula("3/8*2.54*0.01*0.5;")
radius_corner_fold = DoubleInput(0.03)
rectangular_stirrups_columns = Python(IN[0]=column_location, IN[1]=column_dimensions, IN[2]=number_of_rebars_of_each_column_2, IN[3]=transpose, IN[4]=stirrup_radius_m, IN[5]=radius_corner_fold)  # IronPython2
# ---------- rectangular_stirrups_columns.python (239 lines) ----------
# Carga las bibliotecas de DesignScript y normas de Python.
import sys
import clr
clr.AddReference('ProtoGeometry')
from Autodesk.DesignScript.Geometry import *

# INPUT 
dataEnteringNode = IN

ejes = IN[0]
basic_data=IN[1]
nbars_col=IN[2]
typeRebar=IN[3]
rest=IN[4]
rd=IN[5]

dbe=2*rest*100
availableRebar=[[4,1.27,1.266768698],
				[5,1.5875,1.97932609],
				[6,1.905,2.85022957],
				[8,2.54,5.067074791],
				[9,2.8575,6.413016532],
				[10,3.175,7.917304361],
				[12,3.81,11.40091828]]
# Incluya el código debajo de esta línea
sep1=[]
sep2=[]
hone=[]
ne=len(basic_data)
sumnbars=0
H_list=[]
for i in range(0,ne):
	nbars=nbars_col[i][0]
	H=basic_data[i][2]
	H_list.append(H)
	b=basic_data[i][0]
	dbmaxi=0
	
	# To determine the max rebar diameter on each
	# column - since the module numpy has not been imported
	for mri in range(sumnbars,sumnbars+nbars):
		if typeRebar[mri][0]>=dbmaxi:
			dbmaxi=typeRebar[mri][0]
			
	db=availableRebar[dbmaxi-1][1]
	
	s1=min(b/4,6*db)
	s1=min(s1,10)
	
	s2=min(850*db,480*dbe)
	s2=min(s2,b/2)
	
	sep1.append(s1)
	sep2.append(s2)

	h1=max(b/0.4,H/6)
	h1=max(h1,60)
	
	hone.append(h1)
	
	sumnbars=sumnbars+nbars
# The z coordinate location of each stirrup is to be computed
# along each column's length

z=[]
for i in range(0,ne):
	z0=5 # This is the lowest local level of a stirrup in a column 
	ze=[]
	j=0
	while z0<float(hone[i]):
		ze.append(z0)
		z0=z0+sep1[i]
		j=j+1
		
	k=0
	while z0<float(H_list[i]-hone[i]):
		ze.append(z0)
		z0=z0+sep2[i]
		k=k+1
	
	j=0
	while z0<float(H_list[i]):
		ze.append(z0)
		z0=z0+sep1[i]
		j=j+1
		
	z.append(ze)
	
# The global location of each stirrup is now computed:

n_elementos = len(ejes)

lista_x = []
lista_y = []
list_zc = []
list_points_cols = []
for j in range(0, n_elementos):
	ne = len(z[j])
	
	x1 = ejes[j][0]
	lista_x.append(x1)
	y1 = ejes[j][1]
	lista_y.append(y1)
	
	list_points = []
	list_z = []
	for i in range(0, ne):
	    ze = z[j][i] + ejes[j][2]
	    list_z.append(ze)
	    p = Point.ByCoordinates(x1, y1, ze*0.01)
	    list_points.append(p)
	    
	list_zc.append(list_z)

	list_points_cols.append(list_points)
    
# Now, each stirrup for each column is generated as a solid

centro_0=list_zc
centro_1=lista_x
centro_2=lista_y

basicos=basic_data
rv=rest

# Hook length (according to the stirrup's radius)
dstirrup=2*rv
lga=max(6*dstirrup,0.08)

lista_dobleces=[]
lista_ld=[]

nelem=len(centro_2)
for j in range(0,nelem):
	ne=len(centro_0[j])
	b=basicos[j][0]*0.01
	h=basicos[j][1]*0.01
	rec=basicos[j][3]*0.01;
	bp=b-2*rec-rd
	hp=h-2*rec-rd
	xa=centro_1[j]*0.01
	ya=centro_2[j]*0.01
	x=xa+bp*0.5
	y=ya-0.5*hp-rd
	for i in range(0,ne):
		z=centro_0[j][i]*0.01
		# lower-right corner -------------------------------------------
		esq=Point.ByCoordinates(x,y,z)
		n=Vector.ByCoordinates(1,0,0)
		e=Circle.ByCenterPointRadiusNormal(esq,rv,n)
	
		axisOrigin=Point.ByCoordinates(x,y+rd,z)
		axisDir=Vector.ByCoordinates(0,0,1)
		doblez=Solid.ByRevolve(e,axisOrigin,axisDir,0,90)
		lista_dobleces.append(doblez)
		
		# right side ---------------------------------------------------
		cld=Circle.ByCenterPointRadiusNormal(Point.ByCoordinates(x+rd,y+rd,z),rv,Vector.ByCoordinates(0,1,0))
		ld=Curve.Extrude(cld,Vector.ByCoordinates(0,1,0),hp)
		lista_ld.append(ld)
		
		# top right corner ---------------------------------------------
		esq=Point.ByCoordinates(x+rd,hp+rd+y,z)
		n=Vector.ByCoordinates(0,1,0)
		e=Circle.ByCenterPointRadiusNormal(esq,rv,n)
		axisOrigin=Point.ByCoordinates(x,hp+rd+y,z)
		axisDir=Vector.ByCoordinates(0,0,1)
		doblez=Solid.ByRevolve(e,axisOrigin,axisDir,0,90)
		lista_dobleces.append(doblez)
		
		# top side -----------------------------------------------------
		cld=Circle.ByCenterPointRadiusNormal(Point.ByCoordinates(x,hp+2*rd+y,z),rv,Vector.ByCoordinates(1,0,0))
		ld=Curve.Extrude(cld,Vector.ByCoordinates(-1,0,0),bp)
		lista_ld.append(ld)
		
		# top left corner ----------------------------------------------
		esq=Point.ByCoordinates(-bp+x,hp+2*rd+y,z)
		n=Vector.ByCoordinates(1,0,0)
		e=Circle.ByCenterPointRadiusNormal(esq,rv,n)
		axisOrigin=Point.ByCoordinates(-bp+x,hp+rd+y,z)
		axisDir=Vector.ByCoordinates(0,0,1)
		doblez=Solid.ByRevolve(e,axisOrigin,axisDir,0,90)
		lista_dobleces.append(doblez)
		
		# left side ----------------------------------------------------
		cld=Circle.ByCenterPointRadiusNormal(Point.ByCoordinates(x-bp-rd,rd+hp+y,z),rv,Vector.ByCoordinates(0,1,0))
		ld=Curve.Extrude(cld,Vector.ByCoordinates(0,-1,2*rv/hp),hp)
		lista_ld.append(ld)
		
		# lower left corner ---------------------------------------------
		esq=Point.ByCoordinates(-bp+x-rd,rd+y,z+2*rv)
		n=Vector.ByCoordinates(0,1,0)
		e=Circle.ByCenterPointRadiusNormal(esq,rv,n)
		axisOrigin=Point.ByCoordinates(-bp+x,rd+y,z+2*rv)
		axisDir=Vector.ByCoordinates(0,0,1)
		doblez=Solid.ByRevolve(e,axisOrigin,axisDir,0,90)
		lista_dobleces.append(doblez)
		
		# lower side ----------------------------------------------------
		cld=Circle.ByCenterPointRadiusNormal(Point.ByCoordinates(x-bp,y,z+2*rv),rv,Vector.ByCoordinates(1,0,0))
		ld=Curve.Extrude(cld,Vector.ByCoordinates(1,0,0),bp)
		lista_ld.append(ld)
		
		# outer lower right corner
		esq=Point.ByCoordinates(x,y,z+2*rv)
		n=Vector.ByCoordinates(1,0,0)
		e=Circle.ByCenterPointRadiusNormal(esq,rv,n)
		axisOrigin=Point.ByCoordinates(x,y+rd,z+2*rv)
		axisDir=Vector.ByCoordinates(0,0,1)
		doblez=Solid.ByRevolve(e,axisOrigin,axisDir,0,90)
		lista_dobleces.append(doblez)
		
		# right hook ----------------------------------------------------
		esq=Point.ByCoordinates(x+rd,rd+y,z+2*rv)
		n=Vector.ByCoordinates(0,1,0)
		e=Circle.ByCenterPointRadiusNormal(esq,rv,n)
		axisOrigin=Point.ByCoordinates(x,rd+y,z+2*rv)
		axisDir=Vector.ByCoordinates(0,0,1)
		doblez=Solid.ByRevolve(e,axisOrigin,axisDir,0,45)
		lista_dobleces.append(doblez)
		
		lg=Circle.ByCenterPointRadiusNormal(Point.ByCoordinates(0.7071*rd+x,y+1.7071*rd,z+2*rv),rv,Vector.ByCoordinates(-1,1,0))
		ld=Curve.Extrude(lg,Vector.ByCoordinates(-1,1,0),lga)
		lista_ld.append(ld)
		
		# left hook ----------------------------------------------------
		esq=Point.ByCoordinates(x,y,z)
		n=Vector.ByCoordinates(-1,0,0)
		e=Circle.ByCenterPointRadiusNormal(esq,rv,n)
		axisOrigin=Point.ByCoordinates(x,y+rd,z)
		axisDir=Vector.ByCoordinates(0,0,1)
		doblez=Solid.ByRevolve(e,axisOrigin,axisDir,0,-45)
		lista_dobleces.append(doblez)
		
		lg=Circle.ByCenterPointRadiusNormal(Point.ByCoordinates(-0.7071*rd+x,y+(1-0.7071)*rd,z),rv,Vector.ByCoordinates(-1,1,0))
		ld=Curve.Extrude(lg,Vector.ByCoordinates(-1,1,0),lga)
		lista_ld.append(ld)

OUT = [lista_ld,lista_dobleces]
# ----------------------------------------
color_palette_3 = ColorPalette({R: 255, G: 0, B: 255, A: 255})
byGeometryColor_3 = Modifiers.GeometryColor.ByGeometryColor(geometry=rectangular_stirrups_columns, color=color_palette_3)
